# Dynamo graph FaceAreaToCustomProperty.dyn (Dynamo 2.13.1.3887)

code_block = CodeBlock { "面积"; }
select_face = SelectFace()  # 1 picked in the model; graph input
area = SldWorksNodes.Brep.Face.Area(face=select_face)
string_from_object = FromObject(object=area)
byNameText = SldWorksNodes.CustomProperty.CustomProperty.ByNameText(name=code_block, value=string_from_object)
