# Dynamo graph extrued.dyn (Dynamo 2.13.1.3887)

orign = SldWorksNodes.Geometry.Point3D.Orign()
code_block = CodeBlock { 15; Vector3D.ByCoordinates(0,1,1); }
byCenterPointRadius = SldWorksNodes.Geometry.Circle3D.ByCenterPointRadius(center=orign, radius=code_block.out0)
list_create = List.Create(item0=byCenterPointRadius)
byExtrued = SldWorksNodes.Geometry.SolidBody.ByExtrued(curves=list_create, direction=code_block.out1, length=code_block.out0)
